# Dynamo graph Clash report from Navisworks.dyn "ClashReportFromNavisworks" (Dynamo 2.16.2.5624)
# author: Soni J Thomas
# Transfer the Navisworks clash report to Revit by placing a family at the clash point. Load the desired family before running the script (a round family is preferable). Convert the Navisworks HTML (Tabular) report into an Excel file (.xlsx), then specify its file path.
# packages: BumbleBee 2021.25.3, Genius Loci 2024.5.29

family_type_name = StringInput("Clash sphere")  # graph input
byName = FamilyType.ByName(name=family_type_name)
XY = Plane.XY()
toCoordinateSystem = Plane.ToCoordinateSystem(plane=XY)
origin = Point.Origin()
ZAxis = Vector.ZAxis()
get_project_locations = Custom[Get Project Locations]()  # package Genius Loci; Works only in Revit 2018 and later. Retrieves the project positions of the given document in the Survey Coordinate System. (Coordinates of Internal origin, project base point and survey point)
code_block = CodeBlock(PBP=get_project_locations.Project_Base_Point) { PBP[1]; }
rotate = CoordinateSystem.Rotate(coordinateSystem=toCoordinateSystem, origin=origin, axis=ZAxis, degrees=code_block)
code_block_2 = CodeBlock(PBP=get_project_locations.Project_Base_Point) { PBP[0]; }
code_block_3 = CodeBlock(x=code_block_2, y=code_block_2, z=code_block_2) { xi = Autodesk.Point.X(x); yi = Autodesk.Point.Y(y); zi = Autodesk.Point.Z(z); }
code_block_4 = CodeBlock(x=code_block_3.xi, y=code_block_3.yi, z=code_block_3.zi) { -1*x; -1*y; -1*z; }
translate = CoordinateSystem.Translate(coordinateSystem=rotate, xTranslation=code_block_4.out0, yTranslation=code_block_4.out1, zTranslation=code_block_4.out2)
file_path = Filename("D:\Revit Folder\Revit Projects\Test 3\Duct to Beam.xlsx")  # graph input
file_from_path = FileObject(path=file_path)
boolean = BoolSelector(true)
get_worksheet_names = Custom[Get Worksheet Names](filePath=file_from_path, runIt=boolean)  # package BumbleBee; This node will query an Excel file and return a list of sheet names that it contains.
code_block_5 = CodeBlock(x=get_worksheet_names) { x[0]; }
code_block_6 = CodeBlock { true; false; }
importExcel = Data.ImportExcel(file=file_from_path, sheetName=code_block_5, readAsStrings=code_block_6.out0, showExcel=code_block_6.out1)
code_block_7 = CodeBlock { 8; }
dropItems = List.DropItems(list=importExcel, amount=code_block_7)
code_block_8 = CodeBlock { -1; }
dropItems_2 = List.DropItems(list=dropItems, amount=code_block_8)
transpose = List.Transpose(lists=dropItems_2)
code_block_9 = CodeBlock(x=importExcel) { x[7]; }
code_block_10 = CodeBlock(headers=code_block_9)
# ---------- code_block_10.designscript (6 lines) ----------
DSCore.List.IndexOf(headers, "Clash Name");
DSCore.List.IndexOf(headers, "Status");
DSCore.List.IndexOf(headers, "Clash Point");
ID1 = DSCore.List.IndexOf(headers, "Item ID");
ID2 = ID1+3;
DSCore.List.IndexOf(headers, "Grid Location");
# ----------------------------------------
code_block_11 = CodeBlock(list=transpose, I1=code_block_10.out0, I2=code_block_10.out1, I3=code_block_10.out2, I4=code_block_10.ID1, I5=code_block_10.ID2, I6=code_block_10.out5) { names  = list[I1]; satuts = list[I2]; point  = list[I3]; ID1    = list[I4]; ID2    = list[I5]; GL     =  list[I6]; }
code_block_12 = CodeBlock { "x:"; ", y:"; ", z:"; }
split = String.Split(string=code_block_11.point, separator0=code_block_12.out0, separator1=code_block_12.out1, separator2=code_block_12.out2)
toNumber = String.ToNumber(string=split)
convert_by_units = DynamoUnitConvert(toNumber, MeasurementType="autodesk.unit.quantity:length-1.0.4", FromConversion="autodesk.unit.unit:millimeters-1.0.1", ToConversion="autodesk.unit.unit:millimeters-1.0.1")
transpose_2 = List.Transpose(lists=convert_by_units)
code_block_13 = CodeBlock(list=transpose_2) { x = list[0]; y = list[1]; z = list[2]; }
byCartesianCoordinates = Point.ByCartesianCoordinates(coordinateSystem=translate, x=code_block_13.x, y=code_block_13.y, z=code_block_13.z)
byPoint = FamilyInstance.ByPoint(familyType=byName, point=byCartesianCoordinates)
code_block_14 = CodeBlock { " : "; }
split_2 = String.Split(string=code_block_11.GL, separator0=code_block_14)
transpose_3 = List.Transpose(lists=split_2)
code_block_15 = CodeBlock(list=transpose_3) { gl = list[0]; }
code_block_16 = CodeBlock { 0; 12; }
remove = String.Remove(string=code_block_11.ID1, startIndex=code_block_16.out0, count=code_block_16.out1)
remove_2 = String.Remove(string=code_block_11.ID2, startIndex=code_block_16.out0, count=code_block_16.out1)
code_block_17 = CodeBlock(list=transpose_3) { lvl = list[1]; }
code_block_18 = CodeBlock(pts=byCartesianCoordinates) { t1 = Autodesk.Point.X(pts); t2 = Autodesk.Point.Y(pts); t3 = Autodesk.Point.Z(pts); }
code_block_19 = CodeBlock(Fi=byPoint, t2=code_block_11.names, t3=code_block_11.satuts, t6=code_block_15, t9=remove, t10=remove_2, t11=code_block_17, t13=code_block_18.t1, t14=code_block_18.t2, t15=code_block_18.t3)  # unwired: t1, t4, t5, t7, t8
# ---------- code_block_19.designscript (15 lines) ----------
//this writes information to element instances
el1 = Elements.Element.SetParameterByName(Fi, "CRN_TestName", t1);
el2 = Elements.Element.SetParameterByName(Fi, "Clash Name", t2);
el3 = Elements.Element.SetParameterByName(Fi, "Status", t3);
el4 = Elements.Element.SetParameterByName(Fi, "CRN_CommentInfo", t4);
el5 = Elements.Element.SetParameterByName(Fi, "CRN_Comments", t5);
el6 = Elements.Element.SetParameterByName(Fi, "Grid Location", t6);
el7 = Elements.Element.SetParameterByName(Fi, "CRN_Assigned To", t7);
el8 = Elements.Element.SetParameterByName(Fi, "CRN_Approved By", t8);
el9 = Elements.Element.SetParameterByName(Fi, "Element ID_1", t9);
el10 = Elements.Element.SetParameterByName(Fi, "Element ID_2", t10);
el11 = Elements.Element.SetParameterByName(Fi, "EL1 Level", t11);
el13 = Elements.Element.SetParameterByName(Fi, "X Coordinate", t13);
el14 = Elements.Element.SetParameterByName(Fi, "Y Coordinate", t14);
el15 = Elements.Element.SetParameterByName(Fi, "Z Coordinate", t15);
# ----------------------------------------
watch = Watch(code_block_18.t3)
