# Dynamo graph ColumByLevel.dyn (Dynamo 2.16.2.5624)
# author: Soni J Thomas
# Combine 3 parameters in to one text type parameter by a separator

categories = Categories("OST_StructuralColumns")
all_elements_of_category = ElementsOfCategory(Category=categories)
string = StringInput("Comments")
code_block = CodeBlock { "Base Level"; }
getParameterValueByName = Element.GetParameterValueByName(element=all_elements_of_category, parameterName=code_block)
name = Level.Name(level=getParameterValueByName)
string_2 = StringInput("-")
all_elements_of_category_2 = ElementsOfCategory(Category=categories)
code_block_2 = CodeBlock { "Top Level"; }
getParameterValueByName_2 = Element.GetParameterValueByName(element=all_elements_of_category_2, parameterName=code_block_2)
name_2 = Level.Name(level=getParameterValueByName_2)
code_block_3 = CodeBlock(a=name, sep=string_2, b=name_2) { a+sep+b; }
setParameterByName = Element.SetParameterByName(element=all_elements_of_category, parameterName=string, value=code_block_3)
